# Grasshopper definition SAM-exporter-gem.gh (Grasshopper 1.0.8)
# plug-ins: SAM, MetaHopper

py3 = Python3Script()  # -> tolAbs
# ---------- py3: Python ----------
import Rhino
tolAbs=Rhino.RhinoDoc.ActiveDoc.ModelAbsoluteTolerance
# ---------- end py3 ----------

reveal_hidden_wires = RevealHiddenWires(False)
force_comment_colour = ForceCommentColour(True)

unified_tolerance = UnifiedTolerance(py3)
min_panel_area = MinPanelArea(0.0025)

# ---- group: Rename
panel = Panel(" ")
hl_nameghcomp = RenameGHComp21(name="Rapid Calc?:")  # inputs ghComp: list, name: String, nName: String; disabled
# ---------- hl_nameghcomp: Python ----------
ghenv.Component.Name = "rename GH Comp 2.1"
ghenv.Component.NickName = "HL-nameGhComp"

import Grasshopper as gh

if (ghComp is None) or (name is None):

    print("Missing inputs.")

else:

    pyComp=ghenv.Component
    pyPar=pyComp.Params.Input[0]
    source=pyPar.Sources[0]

    try:
        own=source.Attributes.get_Parent().Owner
    except:
        tgt=source
    else:
        tgt=own

    tgt.Name = name

    if nName:
        tgt.NickName = nName
# ---------- end hl_nameghcomp ----------

# ----
# GH Logic
accept_and_continue = AcceptAndContinue(False)

# ---- group: schema
gh_canvas = Col_bg_light(SwatchColor=RGB(201, 198, 190))
gh_darker = Col_bg_dark(SwatchColor=RGB(178, 171, 157))
custom = Col_window_1(SwatchColor=RGB(217, 217, 217))
custom_2 = Col_window_2(SwatchColor=RGB(216, 212, 205))
hl_dark_blue = Col_frame_dark(SwatchColor=RGB(42, 57, 66))
hl_light_blue = Col_accent_1(SwatchColor=RGB(129, 192, 210))
hl_light_purple = Col_accent_2(SwatchColor=RGB(173, 145, 195))
gh_invalid = Col_warning(SwatchColor=RGB(255, 153, 33))
gh_error = Col_error(SwatchColor=RGB(215, 15, 15))

# ----
# Comment Panel Properties
panel_2 = Panel("")
sametype = GetObjectsOfSameType(Objects=panel_2)
filter = StreamFilter(Gate=force_comment_colour, Stream1=sametype)
setpanel = SetPanelProperties(Panel=filter)

# ----
# Initialisation of Canvas
# Show Hidden Wires
wiretoggle = WireDisplayToggle(ShowHiddenWires=reveal_hidden_wires)

# ----
# Adjacencies
rapid_calc = RapidCalc(True)

# ----
# Name Objects
run = Run(False)

# ----
# Shading
run_2 = Run(False)

# ----
# Group Switch
get = Get()
disable = Disable(
    Objects=get,
    Enabled=accept_and_continue,
    AllObjects_Object=[adjacent_geometry_2, shading_geometry_2, window_geometry_2, door_geometry_2, hole_geometry_2, space_data_2, room_volumes])

# ----
# User Interface
# Inputs
room_geometries = RoomGeometries()
shading_geometry = ShadingGeometry()
adjacent_geometry = AdjacentGeometry()
space_data = SpaceData()
door_geometry = DoorGeometry()
window_geometry = WindowGeometry()
hole_geometry = HoleGeometry()

# ----
# Geometry Checks
id = Guid(room_geometries)
hl_checkroomvolumes = CheckRoomVolumes30(geo=flatten(id), geoType="room volume")  # -> result, report; inputs geo: list, geoType: tree
# ---------- hl_checkroomvolumes: Python ----------
import Rhino
import System

ghenv.Component.Name = "Check Room Volumes 3.0"
ghenv.Component.NickName = "HL-CheckRoomVolumes"
 
result=[]
report=[]
 
if geo is not None:
    if not isinstance(geo,list):
        raise RuntimeError(f"Type {type(geo)}, expected {list}")
    else:
        for objIndex,obj in enumerate(geo):
            if not isinstance(obj,System.Guid):
                report.append("Room volumes should not be internalised. Please re-reference.")
                break
            else:
                docObj=Rhino.RhinoDoc.ActiveDoc.Objects.FindId(obj)
                if docObj is not None:
                    if not docObj.Geometry.IsValid:
                        report.append(f"Room volume {objIndex} contained invalid geometry.")
                    elif not isinstance(docObj.Geometry,Rhino.Geometry.Brep):
                        report.append(f"Room volume {objIndex} was not a BREP.")
                    else:
                        result.append(docObj.Id)
# ---------- end hl_checkroomvolumes ----------
hl_checkgeometry = Check2DGeometry30(geo=flatten(door_geometry))  # -> result, report; inputs geo: list, geoType: String
# ---------- hl_checkgeometry: Python ----------
import Rhino
import System

ghenv.Component.Name = "Check 2D Geometry 3.0"
ghenv.Component.NickName = "HL-CheckGeometry"
 
result=[]
report=[]
 
if geo is not None:
    if not isinstance(geo,list):
        raise RuntimeError(f"Type {type(geo)}, expected {list}")
    else:
        for objIndex,obj in enumerate(geo):
            
            objGeometry=None

            if isinstance(obj,System.Guid):
                docObj=Rhino.RhinoDoc.ActiveDoc.Objects.FindId(obj)
                if docObj is not None:
                    objGeometry=docObj.Geometry
            
            elif isinstance(obj,Rhino.Geometry.Brep):
                if len(list(obj.Surfaces))>1:
                    report.append(f"{geoType} {objIndex} was not 2D and single-faced.")
                else:
                    objGeometry=obj
            
            elif isinstance(obj,Rhino.Geometry.Mesh):
                brep=Rhino.Geometry.Brep.CreateFromMesh(obj,False)
                norms=obj.FaceNormals
                success=norms.ComputeFaceNormals()
                norm0=list(norms)[0]
                norm0.Unitize()
                face=list(obj.Faces)[0]
                vertex=obj.Vertices[face.A]
                plane=Rhino.Geometry.Plane(vertex,norm0)
                xForm = Rhino.Geometry.Transform.PlaneToPlane(Rhino.Geometry.Plane.WorldXY, plane)            
                bb=obj.GetBoundingBox(plane)
                
                if bb is not None and bb.IsValid and (round(bb.Volume,3)<=0):
                    pt1=bb.Corner(True,True,True)
                    pt2=bb.Corner(True,False,False)
                    pt3=bb.Corner(False,False,False)
                    pt4=bb.Corner(False,True,True)

                    for pt in [pt1,pt2,pt3,pt4]:
                        pt.Transform(xForm)

                    brep=Rhino.Geometry.Brep.CreateFromCornerPoints(pt1,pt2,pt3,pt4,Rhino.RhinoDoc.ActiveDoc.ModelAbsoluteTolerance)
                    
                    if brep is not None and brep.IsValid:
                        objGeometry=brep
                else:
                    if brep.IsValid:
                        brep.MergeCoplanarFaces(Rhino.RhinoDoc.ActiveDoc.ModelAbsoluteTolerance)
                        objGeometry=brep

            elif isinstance(obj,Rhino.Geometry.Surface): 
                objGeometry=obj

            else:
                report.append(f"{geoType} {objIndex} was an unsupported type ({type(obj)})")

            if objGeometry is None:
                report.append(f"Could not determine geometry for {geoType} {objIndex}.")
            elif not objGeometry.IsValid:
                report.append(f"{geoType} {objIndex} contained invalid geometry.")
            else:
                result.append(objGeometry)
# ---------- end hl_checkgeometry ----------
hl_checkgeometry_2 = Check2DGeometry30(geo=flatten(window_geometry), geoType="window")  # -> result, report; inputs geo: list, geoType: String; same code as hl_checkgeometry
hl_checkgeometry_3 = Check2DGeometry30(geo=flatten(hole_geometry), geoType="hole")  # -> result, report; inputs geo: list, geoType: String; same code as hl_checkgeometry
hl_checkgeometry_4 = CheckGeometry30(geo=flatten(shading_geometry), geoType="shading")  # -> result, report; inputs geo: list, geoType: tree
# ---------- hl_checkgeometry_4: Python ----------
import Rhino
import System

ghenv.Component.Name = "Check Geometry 3.0"
ghenv.Component.NickName = "HL-CheckGeometry"
 
result=[]
report=[]
 
if geo is not None:
    if not isinstance(geo,list):
        raise RuntimeError(f"Type {type(geo)}, expected {list}")
    else:
        for objIndex,obj in enumerate(geo):
            
            objGeometry=None

            if isinstance(obj,System.Guid):
                docObj=Rhino.RhinoDoc.ActiveDoc.Objects.FindId(obj)
                if docObj is not None:
                    objGeometry=docObj.Geometry
            else:
                objGeometry=obj
            
            if objGeometry is None:
                report.append(f"Could not determine geometry for {geoType} {objIndex}.")
            elif not isinstance(obj,Rhino.Geometry.Brep):
                    report.append(f"{geoType} {objIndex} was an invalid geometry type: ({type(obj)}).")
            elif objGeometry.IsValid:
                result.append(objGeometry)
# ---------- end hl_checkgeometry_4 ----------
hl_checkgeometry_5 = Check3DGeometry30(geo=flatten(adjacent_geometry), geoType="adjacent volume")  # -> result, report; inputs geo: list, geoType: tree
# ---------- hl_checkgeometry_5: Python ----------
import Rhino
import System

ghenv.Component.Name = "Check 3D Geometry 3.0"
ghenv.Component.NickName = "HL-CheckGeometry"
 
result=[]
report=[]
 
if geo is not None:
    if not isinstance(geo,list):
        raise RuntimeError(f"Type {type(geo)}, expected {list}")
    else:
        for objIndex,obj in enumerate(geo):
            
            objGeometry=None

            if isinstance(obj,System.Guid):
                docObj=Rhino.RhinoDoc.ActiveDoc.Objects.FindId(obj)
                if docObj is not None:
                    objGeometry=docObj.Geometry
            else:
                objGeometry=obj
            
            if objGeometry is None:
                report.append(f"Could not determine geometry for {geoType} {objIndex}.")
            elif not isinstance(obj,Rhino.Geometry.Brep):
                    report.append(f"{geoType} {objIndex} was an invalid geometry type: ({type(obj)}).")
            elif objGeometry.IsValid:
                amp=Rhino.Geometry.VolumeMassProperties.Compute(objGeometry)
                if amp is not None:
                    if amp.Volume>0.05:
                        result.append(objGeometry)
# ---------- end hl_checkgeometry_5 ----------
hl_printreport = PrintReport(x=flatten([hl_checkroomvolumes.report, hl_checkgeometry_2.report, hl_checkgeometry.report, hl_checkgeometry_3.report, hl_checkgeometry_5.report, hl_checkgeometry_4.report]))  # -> flatten(out); inputs x: list
# ---------- hl_printreport: Python ----------
ghenv.Component.Name = "Print Report"
ghenv.Component.NickName = "HL-PrintReport"
if x is None or x=="" or x==[]:
    pass
else:
    if isinstance(x,list):
        for item in x:
            if item is not None:
                print(f"{item}")
# ---------- end hl_printreport ----------

panel_3 = Panel(hl_printreport)

# ----
# Name Objects
namebyspaces = NameObjectsFromSpaces(spaces=space_data, guids=hl_checkroomvolumes.result, run=run)  # inputs spaces: list, guids: list, run: Boolean
# ---------- namebyspaces: Python ----------
import SAM
import Rhino

ghenv.Component.Name = "name objects from spaces"
ghenv.Component.NickName = "nameBySpaces"

if run:
    tol = Rhino.RhinoDoc.ActiveDoc.ModelAbsoluteTolerance

    guids_s = set(guids)
    spaces_s = set(spaces)
    used = set()

    for space in spaces_s:
        location = space.Location
        pt3d = Rhino.Geometry.Point3d(location.X,location.Y,location.Z)

        for guid in guids_s:
            brep=Rhino.RhinoDoc.ActiveDoc.Objects.Find(guid)
            if brep is not None and guid not in used:
                if not isinstance(brep,Rhino.DocObjects.BrepObject):
                    used.add(guid)
                    raise TypeError(brep)
                else:
                    if brep.Name is None:
                        brepGeo = brep.Geometry
                        if brepGeo.IsValid:
                            if brepGeo.IsPointInside(pt3d,tol,True):
                                atts = brep.Attributes
                                atts.Name = space.Name
                                brep.CommitChanges()
                                used.add(guid)
# ---------- end namebyspaces ----------

# ----
# Stop-gap
room_volumes = RoomVolumes(hl_checkroomvolumes.result)  # disabled
space_data_2 = SpaceData(space_data)  # disabled
door_geometry_2 = DoorGeometry(hl_checkgeometry.result)  # disabled
window_geometry_2 = WindowGeometry(hl_checkgeometry_2.result)  # disabled
shading_geometry_2 = ShadingGeometry(hl_checkgeometry_4.result)  # disabled
adjacent_geometry_2 = AdjacentGeometry(hl_checkgeometry_5.result)  # disabled
hole_geometry_2 = HoleGeometry(hl_checkgeometry_3.result)  # disabled

# ----
# Panel Shading
samanalytical_createpanelby3dgeometry = SAMAnalyticalCreatePanelBy3DGeometry(_3Dgeometry_=flatten(shading_geometry_2), Simplify_=False, Tolerance_=unified_tolerance, SAM_ComponentVersion="1.0.2")  # -> flatten(Panel); disabled
samanalytical_paneltype = SAMAnalyticalPanelType(PanelType=8, SAM_ComponentVersion="1.0.1", SAM_SAMVersion="v20221011.1")  # disabled
samanalytical_setpaneltype = SAMAnalyticalSetPanelType(
    _panel=samanalytical_createpanelby3dgeometry,
    _panelType=samanalytical_paneltype,
    _setDefaultConstruction_=True,
    _setDefaultApertureConstruction_=False,
    SAM_ComponentVersion="1.0.0",
    SAM_SAMVersion="v20221011.1")  # disabled

isnull = IsNull(x=shading_geometry_2)  # -> res, inv; inputs x: list
# ---------- isnull: Python ----------
ghenv.Component.Name = "isNull"
ghenv.Component.NickName = "isNull"

res=True

try:
    print(len(x))
except:
    pass
else:

    for this in x:
        if x:
            res=False
            break

if res:
    print("x is nothing.")
else:
    print("x is something.")

res=x is None
inv=not res
# ---------- end isnull ----------
and = GateAnd(A=run_2, B=isnull.inv)
filter_2 = StreamFilter(Gate=and, Stream1=samanalytical_setpaneltype)

# ----
# Shading
# Group Switch
get_2 = Get()
disable_2 = Disable(
    Objects=get_2,
    Enabled=and,
    AllObjects_Object=[samanalytical_paneltype, samanalytical_setpaneltype, samanalytical_createpanelby3dgeometry])

# ----
# Adjacency Cluster
# full calculation
room_geometries_2 = RoomGeometries(hl_checkroomvolumes.result)

# ----
# Room Names
# Adjacent Names
objfromgroup = GetObjectsInGroup()
hl_mergespacenames = MergeSpaceNames20(geo=room_volumes, spaces=space_data_2)  # -> result; inputs geo: list, spaces: list; disabled
# ---------- hl_mergespacenames: Python ----------
import Rhino
import SAM.Analytical

ghenv.Component.Name = "Merge Space Names 2.0"
ghenv.Component.NickName = "HL-MergeSpaceNames"

result=[]

if geo is not None:
    for objIndex,obj in enumerate(geo):
        
        spaceName=None

        docObj=Rhino.RhinoDoc.ActiveDoc.Objects.FindId(obj)
        
        if docObj is not None:
            if docObj.Name is not None:
                spaceName=docObj.Name

        spaceIndex=None
        if spaces is not None:
            for spaceIndex,space in enumerate(spaces):
                if isinstance(space,SAM.Analytical.Space):
                    location=space.Location
                    if location is not None:
                        pt=Rhino.Geometry.Point3d(location.X,location.Y,location.Z+0.25)
                        geo=docObj.Geometry
                        if geo is not None and geo.IsValid:
                            if geo.IsPointInside(pt,Rhino.RhinoDoc.ActiveDoc.ModelAbsoluteTolerance,False):
                                spaceName=space.Name
                                break
        
        if spaceIndex is not None:
            del spaces[spaceIndex]

        if spaceName is None:
            spaceName=f"cell_{objIndex:04}"
        
        result.append(spaceName)
# ---------- end hl_mergespacenames ----------
fillnames = FillNames10(objs=adjacent_geometry_2, name="adjacent")  # -> a; inputs objs: list, name: String; disabled
# ---------- fillnames: Python ----------
ghenv.Component.Name = "fillNames 1.0"
ghenv.Component.NickName = "fillNames"

if objs is not None:
    if name is None:
        name="object"
    a=[]
    n=1
    for obj in objs:
        a.append(f"{name} {n:03}")
        n+=1
# ---------- end fillnames ----------
clean = CleanTree(RemoveNulls=True, RemoveInvalid=True, RemoveEmpty=True, Tree=fillnames)  # disabled
samanalytical_createadjacencyclusterbybr = SAMAnalyticalCreateAdjacencyClusterByBrepsAndNames(
    _breps=flatten([room_geometries_2, adjacent_geometry_2]),
    _names=flatten([hl_mergespacenames, clean]),
    Tolerance_=unified_tolerance,
    SAM_ComponentVersion="1.0.0")  # disabled

id_2 = Guid(room_geometries_2)

# ----
# Apertures
# Export
# ↑
# defaults to path of
#   this GH canvas.
run_3 = Run(False)
warning = Warning(False)
run_4 = Run(False)
path = FilePath()
panel_4 = Panel(filter_2, SAM_Analytical_Grasshopper_GooPanelParam=True)

# ----
# Adjacency Cluster
# fast calculation
py3_2 = CreateSourceMap(x=id_2, y=adjacent_geometry_2)  # -> listOut, mapOut; inputs x: list, y: list
# ---------- py3_2: Python ----------
ghenv.Component.Name = "CreateSourceMap"
listOut = list()
mapOut = list()

if x is not None:
    for item in x:
        listOut.append(item)
        mapOut.append(0)

if y is not None:
    for item in y:
        listOut.append(item)
        mapOut.append(1)
# ---------- end py3_2 ----------
and_2 = GateAnd(A=warning, B=rapid_calc)
py3_3 = CreateSimpleClusterByBrepsAndNames(breps=flatten(py3_2.listOut), adjacentMap=py3_2.mapOut, run=and_2)  # -> result, adjacents; inputs breps: list, panels: list, adjacentMap: list of Int32, run: Boolean
# ---------- py3_3: Python ----------
import clr
clr.AddReference("SAM.Geometry.Rhino")  
import math
import Rhino
import SAM
import SAM.Geometry.Rhino
from System.Collections.Generic import List
from System import Guid

ghenv.Component.Name = "CreateSimpleClusterByBrepsAndNames"

def face_key(face3D, precision_point=3, precision_area=2, precision_normal=2):
    pt = face3D.GetInternalPoint3D()
    area = face3D.GetArea()
    normal = face3D.GetPlane().Normal
    return (
        round(pt.X, precision_point),
        round(pt.Y, precision_point),
        round(pt.Z, precision_point),
        round(area, precision_area),
        round(normal.X, precision_normal),
        round(normal.Y, precision_normal),
        round(normal.Z, precision_normal),
    )

if run:
    if breps is None:
        raise ReferenceError("No BREPs.")
    elif not (len(breps) == len(adjacentMap)):
        raise IndexError("Length of objects and adjacent map do not match.")
    else:

        tolerance_Distance = SAM.Core.Tolerance.Distance
        silverSpacing = SAM.Core.Tolerance.MacroDistance
        
        result = SAM.Analytical.AdjacencyCluster()    
        tuples = set() #brep,shell,space
        adjacents = list() #names of spaces to be made adjacent condition

        for i,obj in enumerate(breps):
            if not (isinstance(obj,Guid) or isinstance(obj,Rhino.DocObjects.BrepObject) or isinstance(obj,Rhino.Geometry.Brep)):
                raise TypeError(type(obj))
            else:
                brep=None
                name=None

                if isinstance(obj,Rhino.Geometry.Brep):
                    brep=obj
                elif isinstance(obj,Rhino.DocObjects.BrepObject):
                    brep = obj.Geometry
                    name = obj.Name
                elif isinstance(obj,Guid):
                    docObj=Rhino.RhinoDoc.ActiveDoc.Objects.FindId(obj)
                    if docObj is not None and isinstance(docObj,Rhino.DocObjects.BrepObject):
                        brep = docObj.Geometry
                        name = docObj.Name

                if brep is not None and brep.IsValid:    
                    if name is None or len(name)<1:
                        name = "space " + str(i).zfill(3)

                    shell = SAM.Geometry.Rhino.Convert.ToSAM_Shell(brep)
                    loc = shell.InternalPoint3D()
                    space = SAM.Analytical.Space(name,loc)

                    if(shell is not None) and (space is not None):
                        tuples.add((brep,shell,space))
                        if (adjacentMap[i]==1):
                            adjacents.append(name)

        for i,Tuple in enumerate(tuples):

            faceKeys = set()
                
            shell=Tuple[1]
            space=Tuple[2]

            #Verify that space and shell are not None
            if shell is None or space is None:
                continue

            #Set space area
            face3Ds = List[SAM.Geometry.Spatial.Face3D](SAM.Geometry.Spatial.Query.Section(shell))      #What purpose does this serve?
            if face3Ds is not None and len(face3Ds)>0:
                area=0
                for face3D in face3Ds:
                    if face3D is None:
                        continue
                    
                    area_Temp = face3D.GetArea()
                    if isinstance(area_Temp,float) and area_Temp>0:
                        area += area_Temp
                    
                    space.SetValue(SAM.Analytical.SpaceParameter.Area,area)
            
            #Set space volume
            volume = SAM.Geometry.Spatial.Query.Volume(shell)
            if isinstance(volume,float) and volume>0:
                space.SetValue(SAM.Analytical.SpaceParameter.Volume,volume)

            #Add space to cluster
            result.AddObject(space)

            #Construct panels
            for face3D in shell.Face3Ds:

                #Check if equivalent panel already exists in the model
                faceKey = face_key(face3D)
                if not faceKey in faceKeys: 
                        panelType = SAM.Analytical.Query.PanelType(face3D.GetPlane().Normal)
                        construction = SAM.Analytical.Query.DefaultConstruction(panelType)
                        panel = SAM.Analytical.Panel(construction, panelType, face3D)
                        result.AddObject(panel)
                        result.AddRelation(space, panel)
                        faceKeys.add(faceKey)

    
        if panels is not None:
            for i,panel in enumerate(panels):
                if isinstance(panel,SAM.Analytical.Panel):                
                    result.AddObject(panel)
# ---------- end py3_3 ----------

# ----
# fallback
samanalytical_createadjacencyclusterbybr_2 = SAMAnalyticalCreateAdjacencyClusterByBreps(_breps=flatten(Point(0, 0, 0)), Tolerance_=1e-06, SAM_ComponentVersion="1.0.2")
filter_3 = StreamFilter(Gate=rapid_calc, Stream0=samanalytical_createadjacencyclusterbybr, Stream1=py3_3.result)
filter_4 = StreamFilter(Gate=warning, Stream0=samanalytical_createadjacencyclusterbybr_2, Stream1=filter_3)

adjacency_cluster = Output(filter_4)
adjacency_cluster_2 = Internalised(adjacency_cluster)

conditions = Conditions(switch1=warning, switch2=rapid_calc, rVols=room_geometries_2)  # -> result; inputs switch1: Boolean, switch2: Boolean, rVols: list
# ---------- conditions: Python ----------
ghenv.Component.Name = "conditions"
ghenv.Component.NickName = "conditions"

result=False
if switch1 and not switch2:
    if rVols is not None:
        if isinstance(rVols,list):
            if len(rVols)>0:
                result=True
# ---------- end conditions ----------
onoff = EnableDisableObject(
    Objects=objfromgroup,
    Enabled=conditions,
    AllObjects_Object=[hl_mergespacenames, fillnames, clean, samanalytical_createadjacencyclusterbybr])

samanalytical_aperturetype = SAMAnalyticalApertureType(ApertureType=2, SAM_ComponentVersion="1.0.1")  # disabled
samanalytical_aperturetype_2 = SAMAnalyticalApertureType(ApertureType=1, SAM_ComponentVersion="1.0.1")  # disabled
samanalytical_addaperturesbygeometryanda = SAMAnalyticalAddAperturesByGeometryAndApertureType(
    _geometries_=flatten(door_geometry_2),
    _analyticalObject=adjacency_cluster_2,
    _apertureType_=samanalytical_aperturetype,
    MaxDistance_=0.05,
    TrimGeometry_=True,
    MinArea_=0.001,
    SAM_ComponentVersion="1.0.4")  # -> AnalyticalObject, Apertures; disabled
samanalytical_addaperturesbygeometryanda_2 = SAMAnalyticalAddAperturesByGeometryAndApertureType(
    _geometries_=flatten(window_geometry_2),
    _analyticalObject=samanalytical_addaperturesbygeometryanda.AnalyticalObject,
    _apertureType_=samanalytical_aperturetype_2,
    MaxDistance_=0.05,
    TrimGeometry_=True,
    MinArea_=0.001,
    SAM_ComponentVersion="1.0.4")  # -> AnalyticalObject, Apertures; disabled

# ---- group: Control Logic for Holes
isnull_2 = IsNull20(x=hole_geometry_2)  # -> isNone, inv; inputs x: list; disabled
# ---------- isnull_2: Python ----------
ghenv.Component.Name = "isNull 2.0"
ghenv.Component.NickName = "isNull"

def itemIsNone(item):
    if item is None:
        return True
    else:
        if isinstance(item,str):
            if item == "":
                return True
        else:
            return False

isNone=True
if x is not None:
    if isinstance(x,list):
        if len(x)>0:
            isNone=False
            for item in x:
                if itemIsNone(item):
                    isNone=True
                    break
    else:
        isNone=itemIsNone(x)
inv=not isNone
# ---------- end isnull_2 ----------
and_3 = GateAnd(A=run_3, B=isnull_2.inv)  # disabled

# ----
# Group Switch
get_3 = Get()
disable_3 = Disable(
    Objects=get_3,
    Enabled=run_3,
    AllObjects_Object=[samanalytical_aperturetype, samanalytical_aperturetype_2, samanalytical_addaperturesbygeometryanda_2, samanalytical_addaperturesbygeometryanda, isnull_2, and_3, convertairpanels, samanalytical_setpaneltype_2, adjacencycluster_updateobjects, samanalytical_splitpanelsbygeometries, samanalytical_setpaneltype_3, adjacencycluster_updateobjects_2, convertairpanels_2])

# ---- group: First Pass at Holes (100%)
convertairpanels = ConvertAirPanels10(holeGeometries=hole_geometry_2, adjCluster=samanalytical_addaperturesbygeometryanda_2.AnalyticalObject, run=and_3)  # -> out, panelsToUpdate, holesUnmatched; inputs holeGeometries: list; disabled
# ---------- convertairpanels: Python ----------
import math
import Rhino
import SAM 

tol=Rhino.RhinoDoc.ActiveDoc.ModelAbsoluteTolerance
tolAng=Rhino.RhinoDoc.ActiveDoc.ModelAngleToleranceRadians
tolMag=int(str(abs(tol/10))[3:])

ghenv.Component.Name = "Convert Air Panels 1.0"
ghenv.Component.NickName = "convertAirPanels"


def isPointOnFaceWorld(point: Rhino.Geometry.Point3d=None,face=None,allowBounds: bool=True):
    if point is None or face is None:
        print("Error: Missing input(s) from fnc_isPointOnFaceWorld")
        return None
    else:
        if isinstance(face,Rhino.Geometry.BrepFace):
            cp_UV=face.ClosestPoint(point)
            if cp_UV[0]:
                cp=face.PointAt(cp_UV[1],cp_UV[2])
                if cp.DistanceTo(point)<=tol:
                    foo=face.IsPointOnFace(cp_UV[1],cp_UV[2])
                    if allowBounds:
                        if foo==Rhino.Geometry.PointFaceRelation.Exterior:
                            return False
                        else:
                            return True
                    else:
                        if foo==Rhino.Geometry.PointFaceRelation.Interior:
                            return True
                        else:
                            return False
                else:
                    return(False)
            else:
                print("Warning: fnc_isPointOnFaceWorld failed to find a closest point.")
                return(False)
        else:
            print(f"Warning: Method for surface of type {type(face)} not defined in fnc_isPointOnFaceWorld")
            return(None)


if run:
    panelsToUpdate=set()
    holesMatched=set()
    acPanels=list(adjCluster.GetPanels())
    for panel in acPanels:

        ar1=round(panel.GetArea(),tolMag)
        az1=round(panel.GetAzimuth(),tolMag)
        t1=round(panel.GetTilt(),tolMag)
        er1=panel.GetElevationRange()
        er1=(round(er1.get_Min(),tolMag),round(er1.get_Max(),tolMag))
        pt1=panel.GetInternalPoint3D(tol)
        pt1=Rhino.Geometry.Point3d(pt1.X,pt1.Y,pt1.Z)

        az1 = math.radians(az1)
        t1 = math.radians(t1)
        x = math.cos(t1) * math.cos(az1)
        y = math.cos(t1) * math.sin(az1)
        z = math.sin(t1)
        n1=Rhino.Geometry.Vector3d(x,y,z)

        for hole in holeGeometries:
            if isinstance(hole,Rhino.Geometry.Brep):
                faces=hole.Faces
                wasMatched=False
                for face in faces:
                    amp=Rhino.Geometry.AreaMassProperties.Compute(face)
                    ar2=round(amp.Area,tolMag)
                    n2=face.NormalAt(0.5,0.5)
                    
                    pts=face.Brep.Vertices
                    zMin=0
                    zMax=0
                    Rhino.Geometry.BrepVertex.Location

                    for pt in pts:
                        z=round(pt.Location.Z,tolMag)
                        if z<zMin:
                            zMin=z
                        if z>zMax:
                            zMax=z

                    er2=(zMin,zMax)

                    compAr=(abs(ar1-ar2))<=(tol*10)
                    compN=n1.IsPerpendicularTo(n2,tolAng)
                    compEr=er1==er2
                    compPt=isPointOnFaceWorld(pt1,face,False)

                    if compPt and compAr and compN:
                            panelsToUpdate.add(panel)
                            holesMatched.add(hole)
            else:
                print(f"Error: Type {type(hole)}, expected Rhino.Geometry.Brep")

    panelsToUpdate=list(panelsToUpdate)
    holesUnmatched=[]

    for hole in holeGeometries:
        if hole not in holesMatched:
            holesUnmatched.append(hole)
# ---------- end convertairpanels ----------
samanalytical_setpaneltype_2 = SAMAnalyticalSetPanelType(
    _panel=convertairpanels.panelsToUpdate,
    _panelType="Air",
    _setDefaultConstruction_=False,
    _setDefaultApertureConstruction_=False,
    SAM_ComponentVersion="1.0.0")  # -> flatten(Panel); disabled
adjacencycluster_updateobjects = AdjacencyClusterUpdateObjects(
    _adjacencyCluster=samanalytical_addaperturesbygeometryanda_2.AnalyticalObject,
    _objects=samanalytical_setpaneltype_2,
    SAM_ComponentVersion="1.0.1")  # -> AdjacencyCluster, Successful; disabled

# ----
# Apertures
samanalytical_splitpanelsbygeometries = SAMAnalyticalSplitPanelsByGeometries(
    _analytical=adjacencycluster_updateobjects.AdjacencyCluster,
    _geometries=convertairpanels.holesUnmatched,
    SAM_ComponentVersion="1.0.2")  # -> Analytical, Panels; disabled

isnull_3 = IsNull20(x=adjacencycluster_updateobjects.AdjacencyCluster)  # -> isNone, inv; inputs x: list; same code as isnull_2

# ---- group: First Pass at Holes (100%) (continued)
filter_5 = StreamFilter(
    Gate=isnull_3.inv,
    Stream0=samanalytical_addaperturesbygeometryanda_2.AnalyticalObject,
    Stream1=adjacencycluster_updateobjects.AdjacencyCluster)

# ---- group: Second Pass (Splits)
convertairpanels_2 = ConvertAirPanels11(holeGeometries=convertairpanels.holesUnmatched, adjCluster=samanalytical_splitpanelsbygeometries.Analytical, run=run_3)  # -> out, panelsToUpdate, holesUnmatched; inputs holeGeometries: list; disabled
# ---------- convertairpanels_2: Python ----------
import math
import Rhino
import SAM 

tol=Rhino.RhinoDoc.ActiveDoc.ModelAbsoluteTolerance
tolAng=Rhino.RhinoDoc.ActiveDoc.ModelAngleToleranceRadians
tolMag=int(str(abs(tol/10))[3:])

ghenv.Component.Name = "Convert Air Panels 1.1"
ghenv.Component.NickName = "convertAirPanels"


def isPointOnFaceWorld(point: Rhino.Geometry.Point3d=None,face=None,allowBounds: bool=True):
    if point is None or face is None:
        print("Error: Missing input(s) from fnc_isPointOnFaceWorld")
        return None
    else:
        if isinstance(face,Rhino.Geometry.BrepFace):
            cp_UV=face.ClosestPoint(point)
            if cp_UV[0]:
                cp=face.PointAt(cp_UV[1],cp_UV[2])
                if cp.DistanceTo(point)<=tol:
                    foo=face.IsPointOnFace(cp_UV[1],cp_UV[2])
                    if allowBounds:
                        if foo==Rhino.Geometry.PointFaceRelation.Exterior:
                            return False
                        else:
                            return True
                    else:
                        if foo==Rhino.Geometry.PointFaceRelation.Interior:
                            return True
                        else:
                            return False
                else:
                    return(False)
            else:
                print("Warning: fnc_isPointOnFaceWorld failed to find a closest point.")
                return(False)
        else:
            print(f"Warning: Method for surface of type {type(face)} not defined in fnc_isPointOnFaceWorld")
            return(None)


if run and holeGeometries is not None and adjCluster is not None:
    if isinstance(holeGeometries,list) and len(holeGeometries)>0:
        panelsToUpdate=set()
        holesMatched=set()
        acPanels=list(adjCluster.GetPanels())
        for panel in acPanels:

            ar1=round(panel.GetArea(),tolMag)
            az1=round(panel.GetAzimuth(),tolMag)
            t1=round(panel.GetTilt(),tolMag)
            er1=panel.GetElevationRange()
            er1=(round(er1.get_Min(),tolMag),round(er1.get_Max(),tolMag))
            pt1=panel.GetInternalPoint3D(tol)
            pt1=Rhino.Geometry.Point3d(pt1.X,pt1.Y,pt1.Z)

            az1 = math.radians(az1)
            t1 = math.radians(t1)
            x = math.cos(t1) * math.cos(az1)
            y = math.cos(t1) * math.sin(az1)
            z = math.sin(t1)
            n1=Rhino.Geometry.Vector3d(x,y,z)

            for hole in holeGeometries:
                if hole is not None:
                    if isinstance(hole,Rhino.Geometry.Brep):
                        faces=hole.Faces
                        wasMatched=False
                        for face in faces:
                            amp=Rhino.Geometry.AreaMassProperties.Compute(face)
                            ar2=round(amp.Area,tolMag)
                            n2=face.NormalAt(0.5,0.5)
                            
                            pts=face.Brep.Vertices
                            zMin=0
                            zMax=0
                            Rhino.Geometry.BrepVertex.Location

                            for pt in pts:
                                z=round(pt.Location.Z,tolMag)
                                if z<zMin:
                                    zMin=z
                                if z>zMax:
                                    zMax=z

                            er2=(zMin,zMax)

                            compAr=(abs(ar1-ar2))<=(tol*10)
                            compN=n1.IsPerpendicularTo(n2,tolAng)
                            compEr=er1==er2
                            compPt=isPointOnFaceWorld(pt1,face,False)

                            if compPt and compAr and compN:
                                    panelsToUpdate.add(panel)
                                    holesMatched.add(hole)
                    else:
                        print(f"Error: Type {type(hole)}, expected Rhino.Geometry.Brep")

        panelsToUpdate=list(panelsToUpdate)
        holesUnmatched=[]

        for hole in holeGeometries:
            if hole not in holesMatched:
                holesUnmatched.append(hole)
# ---------- end convertairpanels_2 ----------
samanalytical_setpaneltype_3 = SAMAnalyticalSetPanelType(
    _panel=convertairpanels_2.panelsToUpdate,
    _panelType="Air",
    _setDefaultConstruction_=False,
    _setDefaultApertureConstruction_=False,
    SAM_ComponentVersion="1.0.0")  # -> flatten(Panel); disabled
adjacencycluster_updateobjects_2 = AdjacencyClusterUpdateObjects(
    _adjacencyCluster=samanalytical_splitpanelsbygeometries.Analytical,
    _objects=samanalytical_setpaneltype_3,
    SAM_ComponentVersion="1.0.1")  # -> AdjacencyCluster, Successful; disabled

# ----
isnull_4 = IsNull20(x=adjacencycluster_updateobjects_2.AdjacencyCluster)  # -> isNone, inv; inputs x: list; same code as isnull_2

# ---- group: Second Pass (Splits) (continued)
filter_6 = StreamFilter(Gate=isnull_4.inv, Stream0=filter_5, Stream1=adjacencycluster_updateobjects_2.AdjacencyCluster)

# ---- group: Bypass Apertures
bypass = Bypass(Gate=run_3, Stream0=adjacency_cluster_2, Stream1=filter_6)

# ----
samanalytical_createanalyticalmodelbyadj = SAMAnalyticalCreateAnalyticalModelByAdjacencyCluster(
    _name_="000000_SAM_AnalyticalModel",
    _description_="Delivered by SAM https://github.com/HoareLea/SAM [2024/11/15]",
    _saveWeatherData_=False,
    _adjacencyCluster=bypass,
    Panels_=flatten(panel_4),
    SAM_ComponentVersion="1.0.7")

analytical_model = Output(samanalytical_createanalyticalmodelbyadj)
analytical_model_2 = Internalise(analytical_model)

# ----
# Export Process
formatgem = FormatGem20(am=analytical_model_2, loc=path, run=run_4)  # -> file, ok; inputs loc: String, run: Boolean
# ---------- formatgem: Python ----------
import datetime
import Grasshopper as gh
import itertools
import os
import re
import Rhino
import SAM.Analytical

ghenv.Component.Name = "formatGem 2.0"
ghenv.Component.NickName = "formatGem"

ok=True

if not run:
    ok=False
else:
    if am is None:
        ok=False
    elif not isinstance(am,SAM.Analytical.AnalyticalModel):
        ok=False
    elif loc is None:
        doc=ghenv.Component.OnPingDocument()
        loc=doc.FilePath

        foo=list(re.finditer(r"\\",loc))[-1]
        if foo:
            loc=loc[:foo.start()] + "\\"
        else:
            print("File path format not recognised.")
            del loc

    if not os.path.exists(loc):
        print("Error: No valid path found.")
    else:

        #Format Date/Time                   https://docs.python.org/3/library/datetime.html
        now = datetime.datetime.now()
        now = (str(now)).strip()[:19]
        now = now.replace(":","")
        now = now.replace("-","")
        now = now[2:]
        print("Now:",now)

        #Compile Filenames / directories
        fnS = "SAM" + " " + now + ".gem"
        fnF = os.path.join(loc, fnS)

        #Check for existing file
        isFile = os.path.isfile(fnF)

        if isFile:

            n=0
            nLim = 9

            while isFile and n<nLim:
                n+=1 
                uid = "{:02d}".format(n)
                fnT=fnF[:-4]+"-"+str(uid)+".gem"
                print("fnT:",fnT)
                isFile = os.path.isfile(fnT)

                if not(isFile):
                    fnF = fnT
                    break
                else:
                    if n==nLim:
                        print("Error: Too many attempts to save file with this date/time.")
                        wasErr=True
        
        print("Output file: " + fnF)
        file=fnF
# ---------- end formatgem ----------
samanalytical_getspacebyname = SAMAnalyticalGetSpaceByName(_analytical=samanalytical_createanalyticalmodelbyadj, _name=[clean, py3_3.adjacents], SAM_ComponentVersion="1.0.0")
isnull_5 = IsNull20(x=samanalytical_createanalyticalmodelbyadj)  # -> isNone, inv; inputs x: list; same code as isnull_2
and_4 = GateAnd(C=formatgem.ok, A=run_4, B=isnull_5.inv)

clean_2 = CleanTree(RemoveNulls=True, RemoveInvalid=True, RemoveEmpty=True, Tree=samanalytical_getspacebyname)

samanalytical_togem = SAMAnalyticalToGEM(
    _analyticalModel=analytical_model_2,
    Path_=formatgem.file,
    _tolerance_=1e-06,
    _includePerimeterData_=False,
    AdjacentBuildingSpaces_=clean_2,
    _run_=and_4,
    SAM_ComponentVersion="1.0.5")  # -> GEM, Successful
# ← Successful Export?
# File Name →
# Save Location →
filter_7 = StreamFilter(Gate=and_4, Stream0=" ", Stream1=samanalytical_togem.Successful)

export_successful = Panel(filter_7)
