# Grasshopper definition SAM-solver-revit.gh (Grasshopper 1.0.8)
# plug-ins: RhinoCodePluginGH, SAM, Rhino.Inside for Autodesk Revit, MetaHopper

# ---- group: schema
gh_canvas = Col_bg_light(SwatchColor=RGB(201, 198, 190))
gh_darker = Col_bg_dark(SwatchColor=RGB(178, 171, 157))
custom = Col_window_1(SwatchColor=RGB(217, 217, 217))
custom_2 = Col_window_2(SwatchColor=RGB(216, 212, 205))
hl_dark_blue = Col_frame_dark(SwatchColor=RGB(42, 57, 66))
hl_light_blue = Col_accent_1(SwatchColor=RGB(129, 192, 210))
hl_light_purple = Col_accent_2(SwatchColor=RGB(173, 145, 195))
gh_invalid = Col_warning(SwatchColor=RGB(255, 153, 33))
gh_error = Col_error(SwatchColor=RGB(215, 15, 15))

# ----
# Global
# Parameters
# Graphical
# Settings
reveal_hidden_wires = RevealHiddenWires(False)
force_comment_colour = ForceCommentColour(True)
# User Area
unified_tolerance = UnifiedTolerance(1e-08)

min_panel_area = MinPanelArea(0.0025)

# ----
# Comment Panel Properties
panel = Panel("")
sametype = GetObjectsOfSameType(Objects=panel)
filter = StreamFilter(Gate=force_comment_colour, Stream1=sametype)
setpanel = SetPanelProperties(Panel=filter)

# ----
# GH Logic
# Initialisation of Canvas
# Show Hidden Wires
wiretoggle = WireDisplayToggle(ShowHiddenWires=reveal_hidden_wires)

bounding_box = BoundingBox()
inside_only = InsideOnly(True)

# ---- group: Get Linked Models
active = ActiveDocument()
links = QueryRevitLinks(Document=active)  # -> Links, Documents
ins = InsertItems(List=active, Item=links.Documents, Indices=1, Wrap=True)
clean = CleanTree(RemoveNulls=True, RemoveInvalid=True, RemoveEmpty=False, Tree=ins)

# ----
# Fetch Spaces
run = Run(True)

# ----
# Solver
run_2 = Run(False)

# ---- group: Core Settings
level_offset = LevelOffset(0.25)
nakednodesnapdistance = NakedNodeSnapDist(0.5)
bucket_size = BucketSize(0.2)
max_extension = MaxExtension(1)
minwallsegmentlength = MinSegmentLength(0.1)

# ---- group: Advanced Settings
tolerancedistance = ToleranceDistance(1e-06)
toleranceangle = ToleranceAngle(0.034907)
tolerance_arc = ToleranceArc(0.005236)
weights = Weights()

# ----
# Select Sources
select_phase = SelectPhase({"Existing (0163001-HL SAM)": 0, "Existing (0163001-APP-M3-0001-Architectural)": 1, "New Construction (0163001-APP-M3-0001-Architectural)": 2, "New Construction (0163001-HL SAM)": 3}, selected="New Construction (0163001-APP-M3-0001-Architectural)")
select_models = SelectModels(clean)

# ---- group: Get Phases
phases = QueryPhases(Document=[active, links.Documents])  # -> flatten(Phases)
hl_updatevallist = UpdateValueList10(vList=select_phase, phases=phases)  # inputs phases: list
# ---------- hl_updatevallist: Python ----------
ghenv.Component.Name = "Update Value List 1.0"
ghenv.Component.NickName = "HL-updateValList"

import Grasshopper as gh

def parseName(phase):
    if phase is None:
        print("Error parsing phase: Phase is null.")
        return "< error > "
    else:
        name=phase.Name
        source=phase.Document.Title
        return name + " (" + source +")"


if not phases:
    print("No phases provided.")
else:
    try:
        pyComp = ghenv.Component
        pyPar = pyComp.Params.Input[0]
        tgt = pyPar.Sources[0]
    except:
        print("No or invalid input.")
    else:
        if hasattr(tgt, "ListItems"):

            #Check if needs updating:
            current=[]
            items=tgt.ListItems

            for item in items:
                current.append(item.Name)

            new=[]
            for phase in phases:
                new.append(parseName(phase))

            if not(new == current):

                #Set List Items
                tgt.ListItems.Clear()
                for n in range(0,len(phases)):
                    phase=phases[n]
                    vlItem=gh.Kernel.Special.GH_ValueListItem(parseName(phase),str(n))
                    tgt.ListItems.Add(vlItem)
                    tgt.ExpireSolution(True)
# ---------- end hl_updatevallist ----------

# ----
# Get Sources
selected_phase = SelectedPhase(List=phases, Index=select_phase, Wrap=False)

# ---- group: Filter to Only Selected Linked
hl_filtersellink = FilterSelectedLinks(links=links.Links, sel=select_models)  # -> pat; inputs links: list, sel: list
# ---------- hl_filtersellink: Python ----------
ghenv.Component.Name = "filterSelectedLinks"
ghenv.Component.NickName = "HL-filterSelLink"
from Autodesk.Revit.DB import Document
from Autodesk.Revit.DB import RevitLinkInstance

pat=[]
lAll=[]
lSel=[]

for link in links:
    doc=link.GetLinkDocument()
    if not doc is None:
        lAll.append((link.GetLinkDocument().Title))
    else:
        lAll.append(None)

for item in sel:
    lSel.append(item.Title)

for item in lAll:
    if item in lSel:
        pat.append(True)
    else:
        pat.append(False)
# ---------- end hl_filtersellink ----------
dispatch = Dispatch(List=links.Links, DispatchPattern=hl_filtersellink)  # -> ListA, ListB

# ----
hl_isdata = IsData(data=dispatch.ListA)  # -> isData, length; inputs data: list
# ---------- hl_isdata: Python ----------
import Grasshopper as gh
import Rhino
import rhinoscriptsyntax as rs
import scriptcontext as sc

#Component Name
ghenv.Component.Name = "isData"
ghenv.Component.NickName = "HL-isData"
ghenv.Component.Author = "Andrew Peacock"
ghenv.Component.Company = "Hoare Lea"


#Return Variable
isData=False
length=-1
dataType=type(data)


#Function to test if non-list data is initialised
def testSingle(this):

    if isinstance(this,str):
        if (len(this)>0) and (not (this=="Double click to edit panel content…")):
            init=True
        else:
            init=False

    elif isinstance(this,bool):
        init=True
    elif (this):
        init=True
    else:
        init=False    

    return(init)


#Test data
if data:

    #Iterate until valid non-list item
    if not (isinstance(data,list)):
        isData=testSingle(data)         #If single data item, test
    else:

        length=len(data)
        qL=data
 
        #Unpack all lists
        while len(qL)>0:
            
            this=qL[0]

            if isinstance(this,list):
                qL.append(this)
            else:
                if testSingle(this):
                    isData=True
                    break

            del qL[0]
          

#Format outputs
notData=not(isData)
# ---------- end hl_isdata ----------
hl_isactivesel = IsActiveSelected(sel=select_models, doc=active)  # -> isSel; inputs sel: list
# ---------- hl_isactivesel: Python ----------
ghenv.Component.Name = "is Active Selected"
ghenv.Component.NickName = "HL-isActiveSel"

from Autodesk.Revit.DB import Document
ad=doc.Title
isSel=False
for item in sel:
    if item.Title==ad:
        isSel=True
        break
isNot=not isSel
# ---------- end hl_isactivesel ----------

# ---- group: Linked
revit_samanalyticalbytype = RevitSAMAnalyticalByType(
    _type_="Space",
    RevitLinkInstance_=dispatch.ListA,
    Phase_=selected_phase,
    _useProjectLocation_=False,
    _run=run,
    SAM_ComponentVersion="1.0.3")  # -> flatten(AnalyticalObjects)

# ----
# Panel Filters
exclusion_terms = Panel("")

# ----
# Fetch Panels
run_3 = Run(False)

# ---- group: Linked
revit_samanalyticalbytype_2 = RevitSAMAnalyticalByType(
    _type_="Panel",
    RevitLinkInstance_=dispatch.ListA,
    Phase_=selected_phase,
    _useProjectLocation_=False,
    _run=run_3,
    SAM_ComponentVersion="1.0.3")  # -> flatten(AnalyticalObjects); disabled

# ----
# Get Levels
levels = QueryLevels(Document=active, BuildingStory=True)
correct_for_imperial = CorrectForImperial(True)
hl_parselevels = ParseLevels21(lvls=levels, imp=correct_for_imperial)  # -> res; inputs lvls: list
# ---------- hl_parselevels: Python ----------
from Autodesk.Revit.DB import Level

ghenv.Component.Name = "Parse Levels 2.1"
ghenv.Component.NickName = "HL-ParseLevels"

data={}

for i in range(0,len(lvls)):

    lvl=lvls[i]

    if imp:
        data[i]={
            'name':lvl.Name,
            'elevation':(lvl.Elevation)*0.3048        
        }        
    else:
        data[i]={
            'name':lvl.Name,
            'elevation':lvl.Elevation        
        }

sort = dict(sorted(data.items(), key=lambda item: item[1]['elevation']))

#names = [sort[key]['name'] for key in sorted(sort.keys())]

res=[]

for item in sort:
    n=sort[item]['name']
    eM=float(sort[item]['elevation'])
    emm="{:,}".format(int(round(eM*1000,0)))
    e=emm+"mm : " + n
    if not (e in res):
        res.append(e)
# ---------- end hl_parselevels ----------

select_levels = SelectLevels(hl_parselevels)

hl_unparselevels = UnParseLevels10(allLvls=levels, selLvls=select_levels, imp=correct_for_imperial)  # -> els; inputs allLvls: list, selLvls: list, imp: Boolean
# ---------- hl_unparselevels: Python ----------
from Autodesk.Revit.DB import Level

ghenv.Component.Name = "unParse Levels 1.0"
ghenv.Component.NickName = "HL-UnParseLevels"

if (allLvls is None) or (selLvls is None):
    print("Inputs missing.")
else:
    selNames=[]
    els=[]
    seen=set()
    for this in selLvls:
        i=this.find(":")
        if not(i>=0):
            print("Error assessing string. Please check format.")
        else:
            selNames.append(this[i+2:])
    
    for lvl in allLvls:
        name=lvl.Name
        if (name in selNames) and (not(name in seen)):
            seen.add(name)
            el=round(lvl.Elevation,3)

            if imp:
                el=round(el*0.3048,3) 

            els.append(el)
    els.sort()
# ---------- end hl_unparselevels ----------

# ----
# Store Levels
output = Output(hl_unparselevels)
internalise = Internalise(output)

hl_domainfromlist = DomainFromList10(data=internalise)  # -> ints; inputs data: list of Double
# ---------- hl_domainfromlist: Python ----------
#Component Name
ghenv.Component.Name = "domainFromList 1.0"
ghenv.Component.NickName = "HL-domainFromList"
ghenv.Component.Author = "Andrew Peacock"
ghenv.Component.Company = "Hoare Lea"

from Rhino.Geometry import Interval

if not data:
    print("No input.")
else:
    if len(data)<2:
        print("Invalid input.")
    else:
        ints=[]
        for n in range(0,len(data)-1):
            a=data[n]
            b=data[n+1]
            r=Interval(a,b)
            ints.append(r)
# ---------- end hl_domainfromlist ----------

# ----
# Extact Panels
get = Get()
and = GateAnd(A=hl_isactivesel, B=run_3)  # disabled
filter_2 = StreamFilter(Gate=hl_isdata.isData, Stream1=revit_samanalyticalbytype_2)  # disabled
disable = Disable(
    Objects=get,
    Enabled=run_3,
    AllObjects_Object=[revit_samanalyticalbytype_2, merge, revit_samanalyticalbytype_3, and, filter_2, hl_isdata])

# ---- group: Active
revit_samanalyticalbytype_3 = RevitSAMAnalyticalByType(_type_="Panel", Phase_=selected_phase, _useProjectLocation_=False, _run=and, SAM_ComponentVersion="1.0.3")  # -> flatten(AnalyticalObjects); disabled

# ----
merge = Merge(Data1=filter_2, Data2=revit_samanalyticalbytype_3)  # disabled

out = Output(merge, SAM_Analytical_Grasshopper_GooPanelParam=True)
internalise_2 = Internalise(out, SAM_Analytical_Grasshopper_GooPanelParam=True)

# ----
# Original Apertures
panel_2 = Panel(internalise_2, SAM_Analytical_Grasshopper_GooPanelParam=True)
inspect = Inspect(_object=panel_2, SAM_ComponentVersion="1.0.0")  # -> Apertures, PanelType, Type
py3 = Python3Script(panels=panel_2)  # -> h; inputs panels: list
# ---------- py3: Python ----------
if panels is None:
    print("No input.")
elif not isinstance(panels,list):
    print("Invalid input.")
else:
    h=[]
    for panel in panels:
        if not panel is None:
            typ=str(panel.PanelType).strip().lower()
            if typ=="air":
                h.append(panel)
# ---------- end py3 ----------
samcore_filterbytype = SAMCoreFilterByType(_objects=inspect.Apertures, SAM_ComponentVersion="1.0.0")  # -> flatten(Aperture)
py3_2 = Python3Script(apertures=samcore_filterbytype)  # -> d, w, i; inputs apertures: list
# ---------- py3_2: Python ----------
if apertures is None:
    print("No input.")
elif not isinstance(apertures,list):
    print("Invalid input.")
else:
    d=[]
    w=[]
    i=[]

    for ap in apertures:
        if not ap is None:
            typ=str(ap.ApertureType).strip().lower()
            if typ=="door":
                d.append(ap)
            elif typ=="window":
                w.append(ap)
            else:
                i.append(ap)
                
    if (len(i)>0):
        print(len(i),"invalid case(s) found.")
# ---------- end py3_2 ----------

# ----
# Extact Spaces
filter_3 = StreamFilter(Gate=hl_isdata.isData, Stream1=revit_samanalyticalbytype)
get_2 = Get()
and_2 = GateAnd(A=hl_isactivesel, B=run)
disable_2 = Disable(
    Objects=get_2,
    Enabled=run,
    AllObjects_Object=[revit_samanalyticalbytype, merge_2, revit_samanalyticalbytype_4, and_2, filter_3])

# ---- group: Active
revit_samanalyticalbytype_4 = RevitSAMAnalyticalByType(_type_="Space", Phase_=selected_phase, _useProjectLocation_=False, _run=and_2, SAM_ComponentVersion="1.0.3")  # -> flatten(AnalyticalObjects)

# ----
merge_2 = Merge(Data1=filter_3, Data2=revit_samanalyticalbytype_4)

# ---- group: Spaces
output_2 = Output(merge_2)
internalise_3 = Internalise(output_2)

# ----
# Filters
hl_isdata_2 = IsData(data=bounding_box)  # -> isData, length; inputs data: list; same code as hl_isdata

# ---- group: Bounding Box
get_3 = Get()
disable_3 = Disable(Objects=get_3, Enabled=hl_isdata_2.isData, AllObjects_Object=samanalytical_filterbygeometry)
samanalytical_filterbygeometry = SAMAnalyticalFilterByGeometry(
    _analyticals=flatten(internalise_2),
    _brep=bounding_box,
    _insideOnly_=inside_only,
    _tolerance_=unified_tolerance,
    SAM_ComponentVersion="1.0.5")  # -> flatten(In); disabled

# ---- group: Exclusion Terms
hl_isdata_3 = IsData(data=exclusion_terms)  # -> isData, length; inputs data: list; same code as hl_isdata

# ----
filter_4 = StreamFilter(Gate=hl_isdata_2.isData, Stream0=internalise_2, Stream1=samanalytical_filterbygeometry)

# ---- group: Exclusion Terms (continued)
hl_filterpanelbyterms = FilterPanelByTerms10(panel=filter_4, terms=exclusion_terms)  # -> mat; inputs terms: list
# ---------- hl_filterpanelbyterms: Python ----------
#Component Name
ghenv.Component.Name = "filterPanelByTerms 1.0"
ghenv.Component.NickName = "HL-filterPanelByTerms"
ghenv.Component.Author = "Andrew Peacock"
ghenv.Component.Company = "Hoare Lea"

import re

if terms is None:
    print("No search terms")
else:
    if (len(terms)==0) or ((len(terms)==1) and (terms[0]=='')):
        print("No or invalid search terms.")
    else:    

        mat=False

        for term in terms:

            if term[0]=="*" and term[-1]=="*":
                term=term[1:-1]
                st=fr"{term}"
            elif term[0]=="*":
                term=term[1:]
                st=fr"{term}\b"
            elif term[-1]=="*":
                term=term[:-1]
                st=fr"\b{term}"
            else:
                st=fr"\b{term}\b"


            name=str(panel.Name)
            search=re.search(st,name)
            if search:
                mat=True
                break
# ---------- end hl_filterpanelbyterms ----------
dispatch_2 = Dispatch(List=filter_4, DispatchPattern=hl_filterpanelbyterms)  # -> ListA, ListB

# ----
filter_5 = StreamFilter(Gate=hl_isdata_3.isData, Stream0=filter_4, Stream1=dispatch_2.ListB)

out_2 = Output(filter_5, SAM_Analytical_Grasshopper_GooPanelParam=True)
internalise_4 = Internalise(out_2, SAM_Analytical_Grasshopper_GooPanelParam=True)

# ----
# Solver
domain = Domain(hl_domainfromlist)  # disabled
solver = Solver(
    _panels=internalise_4,
    BucketSizes_=bucket_size,
    Weights_=weights,
    MaxExtensions_=max_extension,
    Levels_=domain,
    _levelOffset_=level_offset,
    _nakedNodeSnapDistance_=nakednodesnapdistance,
    _minWallSegmentLength_=minwallsegmentlength,
    _toleranceDistance_=tolerancedistance,
    _toleranceAngle_=toleranceangle,
    _toleranceArc_=tolerance_arc,
    SAM_ComponentVersion="1.0.2")  # -> flatten(Panels), flatten(Shells), NakedEnds; disabled
samanalytical_createshells = SAMAnalyticalCreateShells(_panels=solver.Panels, Offset_=0.1, Tolerance_=unified_tolerance, SAM_ComponentVersion="1.0.2")  # disabled
get_4 = Get()
disable_4 = Disable(Objects=get_4, Enabled=run_2, AllObjects_Object=[solver, domain, samanalytical_createshells])

# ---- group: Shells
isamgeometry = Output(samanalytical_createshells)
isamgeometry_2 = Internalised(isamgeometry)

# ----
pt = NakedEnds(solver.NakedEnds)

# ----
# Solver Apertures
panel_3 = Panel(solver.Panels, SAM_Analytical_Grasshopper_GooPanelParam=True)
inspect_2 = Inspect(_object=panel_3, SAM_ComponentVersion="1.0.0")  # -> Apertures, PanelType, Type
py3_3 = Python3Script(panels=panel_3)  # -> h; inputs panels: list; same code as py3
samcore_filterbytype_2 = SAMCoreFilterByType(_objects=inspect_2.Apertures, SAM_ComponentVersion="1.0.0")  # -> flatten(Aperture)
# ← Successful Export?
# File Name →
# Save Location →
py3_4 = Python3Script(apertures=samcore_filterbytype_2)  # -> d, w, i; inputs apertures: list; same code as py3_2

# ----
# Difference
py3_5 = Python3Script(list1=py3_2.d, list2=py3_4.d, dsc="door(s)")  # -> rpt; inputs list1: list, list2: list, dsc: String
# ---------- py3_5: Python ----------
if list2 is None or list1 is None:
    print("Missing input(s).")
else:
    d=len(list2)-len(list1)
    if d<0:
        rpt=" ".join([str(abs(d)),dsc,"were lost."])
    elif d>0:
        rpt=" ".join([str(d),dsc,"were gained."])
    else:
        rpt=" ".join(["No",dsc,"were gained or lost."])
print(rpt)
# ---------- end py3_5 ----------
py3_6 = Python3Script(list1=py3_2.w, list2=py3_4.w, dsc="window(s)")  # -> rpt; inputs list1: list, list2: list, dsc: String; same code as py3_5
py3_7 = Python3Script(list1=py3, list2=py3_3, dsc="hole(s)")  # -> rpt; inputs list1: list, list2: list, dsc: String; same code as py3_5
lng = ListLength(List=solver.NakedEnds)  # -> flatten(Length)
concat = Concatenate(FragmentA=lng, FragmentB=" naked ends were found.")

# ----
# Workaround
toggle = TakeUnsolvedApertures(False)
filter_6 = StreamFilter(Gate=toggle, Stream0=py3_4.d, Stream1=py3_2.d)
filter_7 = StreamFilter(Gate=toggle, Stream0=py3_4.w, Stream1=py3_2.w)
filter_8 = StreamFilter(Gate=toggle, Stream0=py3_3, Stream1=py3)

# ---- group: Door Apertures
aperture = Output(filter_6)
aperture_2 = Internalised(aperture)

# ---- group: Window Apertures
aperture_3 = Output(filter_7)
aperture_4 = Internalised(aperture_3)

# ---- group: Air Holes
out_3 = Output(filter_8, SAM_Analytical_Grasshopper_GooPanelParam=True)
internalise_5 = Internalise(out_3, SAM_Analytical_Grasshopper_GooPanelParam=True)
